# Dynamo graph Get_Rooms_RAD.dyn "Get_Rooms_2" (Dynamo 2.16.4.10216)
# author: Radu
# Gets the Level, Room Name and Room Number  and implements it in the casework elements (for all elements)

python_script = Python()  # CPython3; unwired: IN[0]
# ---------- python_script.python (156 lines) ----------
# Dynamo CPython3 — Linked Rooms -> Casework (Player-friendly)
# OUT[0]: one-line summary for Dynamo Player
# OUT[1]: detailed log list

import clr
clr.AddReference('RevitServices')
from RevitServices.Persistence import DocumentManager
from RevitServices.Transactions import TransactionManager

clr.AddReference('RevitAPI')
from Autodesk.Revit.DB import *

# --------------------------- USER CONFIG ---------------------------
AUTHOR_GITHUB = "https://github.com/RaduIoanM"
PREF_LINK_NAME = None  # set to substring of link name if you want to lock it
TARGET_PARAMS = {
    "level":  "LPT_Position",
    "number": "LPT_RaumNummer",
    "name":   "LPT_UnterPosition"
}
# -------------------------------------------------------------------

doc   = DocumentManager.Instance.CurrentDBDocument
uidoc = DocumentManager.Instance.CurrentUIApplication.ActiveUIDocument

def get_casework():
    sel_ids = list(uidoc.Selection.GetElementIds())
    if sel_ids:
        sel = [doc.GetElement(i) for i in sel_ids]
        return [e for e in sel if isinstance(e, FamilyInstance) and
                e.Category and e.Category.Id.IntegerValue == int(BuiltInCategory.OST_Casework)]
    return list(FilteredElementCollector(doc).OfCategory(BuiltInCategory.OST_Casework)
                .WhereElementIsNotElementType())

def choose_link(name_hint=None):
    links = list(FilteredElementCollector(doc).OfClass(RevitLinkInstance))
    if not links:
        return None, None
    if name_hint:
        for l in links:
            if name_hint.lower() in (l.Name or "").lower():
                ld = l.GetLinkDocument()
                if ld:
                    return l, ld
    for l in links:
        ld = l.GetLinkDocument()
        if ld is None: continue
        has_rooms = any(1 for _ in FilteredElementCollector(ld).OfCategory(BuiltInCategory.OST_Rooms)
                        .WhereElementIsNotElementType())
        if has_rooms:
            return l, ld
    return None, None

def inst_point(fi):
    loc = fi.Location
    if isinstance(loc, LocationPoint) and loc.Point:
        return loc.Point
    bb = fi.get_BoundingBox(None)
    if bb:
        return (bb.Min + bb.Max) * 0.5
    return None

def find_room(link_inst, link_doc, host_pt):
    try:
        lpt = link_inst.GetTotalTransform().Inverse.OfPoint(host_pt)
    except:
        return None
    rooms = FilteredElementCollector(link_doc).OfCategory(BuiltInCategory.OST_Rooms) \
                .WhereElementIsNotElementType()
    for r in rooms:
        try:
            if r.IsPointInRoom(lpt):
                return r
        except:
            pass
    return None

def level_name(link_doc, room):
    try:
        lvl = link_doc.GetElement(room.LevelId)
        if lvl:
            return lvl.Name
    except:
        pass
    try:
        p = room.get_Parameter(BuiltInParameter.LEVEL_NAME)
        if p and p.HasValue:
            return p.AsString()
    except:
        pass
    return ""

def set_text(fi, pname, text):
    p = fi.LookupParameter(pname)
    if p and not p.IsReadOnly:
        try:
            p.Set("" if text is None else str(text))
            return True
        except:
            return False
    return False

# ----- Main Execution -----
cw = get_casework()
link_inst, link_doc = choose_link(PREF_LINK_NAME)

log = []
ok = skip = 0

if not cw:
    OUT = ["No Casework found.\n" + AUTHOR_GITHUB, []]
elif link_doc is None:
    OUT = ["No linked Rooms found.\n" + AUTHOR_GITHUB, []]
else:
    TransactionManager.Instance.EnsureInTransaction(doc)
    for fi in cw:
        pt = inst_point(fi)
        if not pt:
            skip += 1
            fam_name = fi.Symbol.Family.Name if hasattr(fi, "Symbol") else "(no family)"
            type_name = fi.Name
            log.append(f"Skip {fam_name} : {type_name} — no point")
            continue
        room = find_room(link_inst, link_doc, pt)
        if not room:
            skip += 1
            fam_name = fi.Symbol.Family.Name if hasattr(fi, "Symbol") else "(no family)"
            type_name = fi.Name
            log.append(f"Skip {fam_name} : {type_name} — no linked room at location")
            continue

        num = room.get_Parameter(BuiltInParameter.ROOM_NUMBER)
        namep = room.get_Parameter(BuiltInParameter.ROOM_NAME)
        rnum = num.AsString() if num and num.HasValue else ""
        rname = namep.AsString() if namep and namep.HasValue else ""
        rlvl = level_name(link_doc, room)

        wrote = False
        wrote |= set_text(fi, TARGET_PARAMS["level"],  rlvl)
        wrote |= set_text(fi, TARGET_PARAMS["number"], rnum)
        wrote |= set_text(fi, TARGET_PARAMS["name"],   rname)

        fam_name = fi.Symbol.Family.Name if hasattr(fi, "Symbol") else "(no family)"
        type_name = fi.Name
        if wrote:
            ok += 1
            log.append(f"OK {fam_name} : {type_name} | {rlvl} | {rnum} | {rname}")
        else:
            skip += 1
            log.append(f"Skip {fam_name} : {type_name} — parameters missing/read-only")
    TransactionManager.Instance.TransactionTaskDone()

    link_name = link_inst.Name if hasattr(link_inst, "Name") else "(link)"
    summary_line1 = f"Kudos! {ok} updated, {skip} skipped. Go check them out!"
    summary_line2 = f"Feel free to drop some feedback 🦆 {AUTHOR_GITHUB} 🦆 Thanks a bunch!"
    OUT = [[summary_line1, summary_line2], log]
# ----------------------------------------
watch = Watch(python_script)  # graph output
string = StringInput("Kudos! Now go to the objects and double check it :) let me know if it workedfeedback here  🦆  https://github.com/RaduIoanM  🦆 Thanks a bunch! ")  # frozen
