# Dynamo graph Getlist.dyn (Dynamo 3.5.0.8297)
# author: Radu
# Gets casework elements and turns them into an excel llist
# packages: archi-lab.net 2025.300.1225, Genius Loci 2024.5.29

categories = Categories("OST_Casework")
all_elements_of_category = ElementsOfCategory(Category=categories)
python_script = Python(IN[0]=all_elements_of_category)  # CPython3
# ---------- python_script.python (15 lines) ----------
elements = IN[0]
out = []

# Only include items that *do not* look like subcomponents
exclude = ["platte", "rohr", "tisch", "rahmen", "front"]

for e in elements:
    try:
        name = e.Name.lower()
        if not any(x in name for x in exclude):
            out.append(e)
    except:
        continue

OUT = out
# ----------------------------------------
type = archilab.Revit.Elements.Elements.Type(element=python_script)
id = Element.Id(element=python_script)
input_family_name_familename = StringInput("Family Name")  # graph input
getParameterValueByName = Element.GetParameterValueByName(element=python_script, parameterName=input_family_name_familename)
name = Element.Name(element=python_script)
python_script_2 = Python(IN[0]=getParameterValueByName)  # CPython3
# ---------- python_script_2.python (7 lines) ----------
OUT = []
for e in IN[0]:
    try:
        g = e.Group
        OUT.append(g.Name)
    except:
        OUT.append("Ungrouped")
# ----------------------------------------
input_family_name_familename_2 = StringInput("Comments")
getParameterValueByName_2 = Element.GetParameterValueByName(element=python_script, parameterName=input_family_name_familename_2)
input_family_name_familename_3 = StringInput("Mark")
getParameterValueByName_3 = Element.GetParameterValueByName(element=python_script, parameterName=input_family_name_familename_3)
list_create = List.Create(item0=id, item1=getParameterValueByName, item2=name, item3=python_script_2, item4=getParameterValueByName_2, item5=getParameterValueByName_3)
transpose = List.Transpose(lists=list_create)
exportCSV = Data.ExportCSV(data=transpose)  # frozen; unwired: filePath
coda = StringInput("Kudos! Now go to the folder and double check it :) let me know if it workedfeedback here  🦆  https://github.com/RaduIoanM  🦆 Thanks a bunch! ")  # graph output
element_host = Custom[Element Host]()  # frozen; package Genius Loci; Gets the host of the element. Unlike the OOTB node FamilyInstance.GetHost, it also works for elements hosted by a linked document, wall sweeps, foundations, railings and builing pads. Based on a Clockwork's node; unwired: element
isNull = Object.IsNull(object=element_host)  # frozen
filterByBoolMask = List.FilterByBoolMask(mask=isNull)  # frozen; unwired: list
where_would_you_like_the_csv = Filename("..\..\..\Downloads\BKP_FAM\tes.xlsx")  # "Where would you like the csv saved?"; graph input
python_script_3 = Python(IN[0]=where_would_you_like_the_csv, IN[1]=transpose)  # CPython3; unwired: IN[2]
# ---------- python_script_3.python (23 lines) ----------
import csv
import os
from System.Diagnostics import Process

file_path = IN[0]
data = IN[1]

# Ensure CSV extension
if not file_path.lower().endswith(".csv"):
    file_path = os.path.splitext(file_path)[0] + ".csv"

# Write CSV
with open(file_path, 'w', newline='') as f:
    writer = csv.writer(f)
    for row in data:
        writer.writerow(row)

# Launch Excel with full path
excel_path = r"C:\Program Files\Microsoft Office\root\Office16\EXCEL.EXE"
if os.path.exists(file_path) and os.path.exists(excel_path):
    Process.Start(excel_path, file_path)

OUT = file_path
# ----------------------------------------
