# Dynamo graph Getlistgroups.dyn (Dynamo 3.5.0.8297)
# author: Radu
# Gets casework elements and turns them into an excel llist

# group: Get_groups
choose_your_model_groups = DSModelElementMultipleSelection()  # 2 picked in the model; graph input
choose_a_file_path = Filename("..\..\..\Downloads\TotalCasework.xlsx")  # graph input
casework = Python(IN[0]=choose_your_model_groups, IN[1]=choose_a_file_path)  # CPython3
# ---------- casework.python (124 lines) ----------
import clr
clr.AddReference("RevitAPI")
clr.AddReference("RevitServices")
clr.AddReference("System")

from Autodesk.Revit.DB import *
from RevitServices.Persistence import DocumentManager
import System
import os
import subprocess
import csv
from collections import defaultdict

doc = DocumentManager.Instance.CurrentDBDocument

# --- Inputs ---
group_instances = UnwrapElement(IN[0])  # Multiple model groups
filepath = IN[1]

if not isinstance(group_instances, list):
    group_instances = [group_instances]

# --- Helpers ---
def is_casework(elem):
    return elem.Category and elem.Category.Name == "Casework"

def is_group(elem):
    return isinstance(elem, Group)

def get_member_elements(group):
    try:
        return [doc.GetElement(eid) for eid in group.GetMemberIds()]
    except:
        return []

def get_loose_casework(group):
    all_members = get_member_elements(group)
    nested_group_ids = []
    for e in all_members:
        if is_group(e):
            nested_group_ids.extend(e.GetMemberIds())
    return [e for e in all_members if is_casework(e) and e.Id not in nested_group_ids]

def group_contains_casework(group, collected, excluded):
    members = get_member_elements(group)
    has_casework = False
    for e in members:
        if is_group(e):
            if group_contains_casework(e, collected, excluded):
                has_casework = True
        elif is_casework(e):
            has_casework = True
    if has_casework and group.Id not in excluded:
        collected.add(group)
    return has_casework

def summarize_loose(elements):
    summary = defaultdict(int)
    for e in elements:
        try:
            fam = e.Symbol.Family.Name
            typ = e.Name
            summary[(fam, typ)] += 1
        except:
            continue
    return summary

def summarize_groups(groups):
    counter = defaultdict(int)
    for g in groups:
        try:
            name = g.Name
            counter[(name, "*Group*")] += 1
        except:
            continue
    return counter

# --- Main execution ---
final_rows = []
grand_total = 0

for main_group in group_instances:
    title = "Group: " + main_group.Name
    final_rows.append([title])
    final_rows.append(["Category", "Family / Group", "Type", "Count"])

    loose = get_loose_casework(main_group)
    nested_groups = set()
    excluded = {main_group.Id}
    group_contains_casework(main_group, nested_groups, excluded)

    loose_summary = summarize_loose(loose)
    group_summary = summarize_groups(nested_groups)

    group_total = 0

    for (fam, typ), count in sorted(loose_summary.items(), key=lambda x: x[1]):
        final_rows.append(["Casework", fam, typ, count])
        group_total += count

    for (gname, typ), count in sorted(group_summary.items(), key=lambda x: x[1]):
        final_rows.append(["Casework", gname, typ, count])
        group_total += count

    grand_total += group_total
    final_rows.append(["", "", f"TOTAL for Group: {main_group.Name}", group_total])
    final_rows.append([])

# --- Append grand total at bottom ---
final_rows.append(["", "", "GRAND TOTAL", grand_total])

# --- Export CSV ---
csv_path = filepath.replace(".xlsx", ".csv")
with open(csv_path, "w", newline='', encoding='utf-8') as f:
    writer = csv.writer(f)
    writer.writerows(final_rows)

# --- Try to open the file ---
try:
    subprocess.Popen(['start', csv_path], shell=True)
except:
    pass

OUT = "Export complete with totals → " + csv_path
# ----------------------------------------

review = StringInput("Kudos! Now go to the folder and double check it :) let me know if it workedfeedback here  🦆  https://github.com/RaduIoanM  🦆 Thanks a bunch! ")  # graph output
