# Dynamo graph IFC_batchemall.dyn (Dynamo 2.6.1.8786)

# group: Inputs
enter_ifc_export_version = StringInput("IFC2x3 Coordination View")  # "Enter IFC Export Version (optional)"
enter_custom_save_path_optional = StringInput("C:\Users\radum\Downloads")  # graph input
export_folder_select_path = StringInput("C:\Temp\IFC_Exports")
enter_3d_views_to_export_comma = StringInput("tree")  # "Enter 3D Views to Export (Comma-Separated)"; graph input

# group: Chekc IFC views
python_script = Python()  # unwired: IN[0]
# ---------- python_script.python (13 lines) ----------
import clr
clr.AddReference("RevitServices")
clr.AddReference("RevitAPI")
from RevitServices.Persistence import DocumentManager
from Autodesk.Revit.DB import *

# Get active Revit document
doc = DocumentManager.Instance.CurrentDBDocument

# Get available IFC versions from the Revit API
available_versions = [attr for attr in dir(IFCVersion) if not attr.startswith("__")]

OUT = available_versions
# ----------------------------------------
watch = Watch(python_script)

# group: Core
IFC_batch = Python(IN[0]=export_folder_select_path, IN[1]=enter_3d_views_to_export_comma)
# ---------- IFC_batch.python (84 lines) ----------
import clr
import os
import sys

# Import Revit API
clr.AddReference('RevitServices')
from RevitServices.Persistence import DocumentManager

clr.AddReference('RevitAPI')
from Autodesk.Revit.DB import FilteredElementCollector, View, IFCExportOptions, Transaction

# Try importing Windows Forms for pop-ups (ignored in Dynamo Player)
try:
    clr.AddReference('System.Windows.Forms')
    from System.Windows.Forms import MessageBox
    use_messagebox = True
except:
    use_messagebox = False  # Ignore pop-ups in Dynamo Player

# --- INPUTS FROM DYNAMO ---
export_folder = IN[0]  # Folder where IFC files will be exported
views_list = IN[1]  # List of view names for export

# Ensure views_list is a proper list (Fix Dynamo Player interpreting it as a single string)
if isinstance(views_list, str):
    views_list = [v.strip() for v in views_list.split(",")]  # Split by comma and trim spaces

# Get active document
doc = DocumentManager.Instance.CurrentDBDocument

# --- ERROR HANDLING ---
errors = []

# 1. Ensure the export folder exists (create if missing)
if not os.path.exists(export_folder):
    try:
        os.makedirs(export_folder)
    except Exception as e:
        errors.append("⚠️📁 Error: Could not create folder: {}\n{}".format(export_folder, str(e)))

# 2. Check if views exist in Revit
all_views = {v.Name: v for v in FilteredElementCollector(doc).OfClass(View)}  # Get all views
missing_views = [v for v in views_list if v not in all_views]

if missing_views:
    errors.append("⚠️😵 Error: Views not found: {}".format(", ".join(missing_views)))

# --- EXECUTION ---
if errors:
    # If errors exist, show message in Dynamo Player
    error_message = "\n".join(errors)
    OUT = "❌🕵️ Script failed with errors:\n{}".format(error_message)

    # Show pop-up in full Dynamo (not in Dynamo Player)
    if use_messagebox:
        MessageBox.Show(error_message, "Dynamo IFC Export Error")

else:
    # Proceed with IFC export
    success_exports = []
    
    with Transaction(doc, "Batch IFC Export") as t:
        t.Start()
        for view_name in views_list:
            view = all_views.get(view_name)
            if view:
                # Define IFC file path
                ifc_file = os.path.join(export_folder, "{}.ifc".format(view_name))

                # Export IFC
                doc.Export(export_folder, "{}.ifc".format(view_name), IFCExportOptions())
                success_exports.append(ifc_file)  # Append full file path to the list

        t.Commit()

    # Join full paths correctly in the success message
    success_message = "✅ IFC Export Completed!\n\nCheck your results in the main path and feel free to give me some feedback https://github.com/RaduIoanM/. Thanks, Radu!🦆🤝\n\nFiles saved in: {}\nExported:\n{}".format(
        export_folder, "\n".join(success_exports)  # Ensure proper formatting
    )
    OUT = success_message

    # Show pop-up in full Dynamo (not in Dynamo Player)
    if use_messagebox:
        MessageBox.Show(success_message, "Dynamo IFC Export Completed")
# ----------------------------------------

# group: Result
watch_2 = Watch(IFC_batch)

# group: Output (integrated)
output = Python()  # frozen; unwired: IN[0]
# ---------- output.python (19 lines) ----------
import clr

# If running inside full Dynamo, this will work, but Dynamo Player does NOT support pop-ups
try:
    clr.AddReference('System.Windows.Forms')
    from System.Windows.Forms import MessageBox
    
    # Message text
    message = "✅ Your Dynamo script has completed successfully!"
    title = "Dynamo Notification"

    # Show message box (Only works in full Dynamo, not Dynamo Player)
    MessageBox.Show(message, title)

except:
    pass  # Ignore errors if running in Dynamo Player

# Ensure output message appears in Dynamo Player's output panel
OUT = "✅ Script executed successfully! Check your results in the main path and feel free to give some feedback https://github.com/RaduIoanM/. Thanks!"
# ----------------------------------------
watch_3 = Watch()  # unwired: arg0

# group: Available 3d Views
lists_3d_views = Python()  # unwired: IN[0]
# ---------- lists_3d_views.python (15 lines) ----------
import clr
clr.AddReference("RevitServices")
clr.AddReference("RevitAPI")
from RevitServices.Persistence import DocumentManager
from Autodesk.Revit.DB import *

# Get the active Revit document
doc = DocumentManager.Instance.CurrentDBDocument

# Collect all 3D views (excluding templates)
collector = FilteredElementCollector(doc).OfClass(View3D)
view_names = [view.Name for view in collector if not view.IsTemplate]

# Output the list for Dynamo Player
OUT = ["Available 3D Views:"] + view_names
# ----------------------------------------

code_block = CodeBlock {  }
