# Dynamo graph doors 2 - increment.dyn "Door To From Data using Dynamo2" (Dynamo 2.6.1.8786)
# packages: spring nodes 210.1.1, Clockwork for Dynamo 2.x 2.6.0, archi-lab.net 2023.213.1722

ꟿ_collect_currentselection = Custom[ꟿ Collect.CurrentSelection]()  # package spring nodes; Gets the currently selected elements. Connect a boolean switch to refresh the selection.
string = StringInput("von Raum")
rooms = Custom[Door.Rooms](door=ꟿ_collect_currentselection)  # package Clockwork for Dynamo 2.x; Gets the rooms that are connected by a given door
number = Room.Number(room=rooms.fromRoom)
string_2 = StringInput("No Room\n")
replaceNull = archilab.Lists.Lists.ReplaceNull(list=number, replacement=string_2)
setParameterByName = Element.SetParameterByName(element=ꟿ_collect_currentselection, parameterName=string, value=replaceNull)
string_3 = StringInput("zu Raum")
number_2 = Room.Number(room=rooms.toRoom)
string_4 = StringInput("No Room\n")
replaceNull_2 = archilab.Lists.Lists.ReplaceNull(list=number_2, replacement=string_4)
setParameterByName_2 = Element.SetParameterByName(element=ꟿ_collect_currentselection, parameterName=string_3, value=replaceNull_2)
