# Dynamo graph doors 3 - check.dyn "Door To From Data using Dynamo3" (Dynamo 2.6.1.8786)
# packages: spring nodes 210.1.1, Clockwork for Dynamo 2.x 2.6.0

ꟿ_collect_currentselection = Custom[ꟿ Collect.CurrentSelection]()  # package spring nodes; Gets the currently selected elements. Connect a boolean switch to refresh the selection.
rooms = Custom[Door.Rooms](door=ꟿ_collect_currentselection)  # package Clockwork for Dynamo 2.x; Gets the rooms that are connected by a given door
watch = Watch(rooms.roomCount)
code_block = CodeBlock { 2; }
lt = rooms.roomCount < code_block
filterByBoolMask = List.FilterByBoolMask(list=ꟿ_collect_currentselection, mask=lt)
code_block_2 = CodeBlock { 255; 255; 125; 0; }
byARGB = Color.ByARGB(a=code_block_2.out0, r=code_block_2.out1, g=code_block_2.out2, b=code_block_2.out3)
number = DoubleInput(6)
byProperties = Revit.Filter.OverrideGraphicSettings.ByProperties(cutFillColor=byARGB, projectionFillColor=byARGB, cutLineColor=byARGB, projectionLineColor=byARGB, cutLineWeight=number, projectionLineWeight=number)
overrideInView = Element.OverrideInView(element=filterByBoolMask.in, overrides=byProperties)
code_block_3 = CodeBlock {  }
