# Dynamo graph ex 4 -more filtering logic - rooms.dyn (Dynamo 2.6.1.8786)

# group: Get Instance (Area) parameter
string = StringInput("Area")
getParameterValueByName = Element.GetParameterValueByName(parameterName=string)  # unwired: element

string_2 = StringInput("Department")
getParameterValueByName_2 = Element.GetParameterValueByName(parameterName=string_2)  # unwired: element

# group: Get filtered instances of Rooms > 40 sqm and merge with the second list of renamed parameter
list_create = List.Create(item0=getParameterValueByName, item1=getParameterValueByName_2)

# group: Get rooms with Department Parameter and rename them
parameterByName = Parameter.ParameterByName(name=string_2)  # unwired: element
string_3 = StringInput("BIG DEPARTMENT\n")
setValue = Parameter.SetValue(parameter=parameterByName, value=string_3)

# group: Get a list of all Rooms > 40 sqm
categories = Categories("OST_Rooms")
all_elements_of_category = ElementsOfCategory(Category=categories)
string_4 = StringInput("Area")
getParameterValueByName_3 = Element.GetParameterValueByName(element=all_elements_of_category, parameterName=string_4)
code_block = CodeBlock { 40; }
gt = getParameterValueByName_3 > code_block
filterByBoolMask = List.FilterByBoolMask(list=all_elements_of_category, mask=gt)

list_create_2 = List.Create(item0=filterByBoolMask.in, item1=filterByBoolMask.out)
flatten = List.Flatten(list=list_create_2)
string_5 = StringInput("Department")
getParameterValueByName_4 = Element.GetParameterValueByName(element=flatten, parameterName=string_5)
length = String.Length(str=getParameterValueByName_4)
number_slider = DoubleSlider(0, range=0..100 step 0.1)
ne = length != number_slider
filterByBoolMask_2 = List.FilterByBoolMask(list=flatten, mask=ne)
