# Dynamo graph ex 5-to practice list making and editing.dyn (Dynamo 2.6.1.8786)

# group: Create List of Rooms
categories = Categories("OST_Rooms")
all_elements_of_category = ElementsOfCategory(Category=categories)

# group: Room Location
location = Room.Location(room=all_elements_of_category)  # frozen

# group: Create List of Doors
categories_2 = Categories("OST_Doors")
all_elements_of_category_2 = ElementsOfCategory(Category=categories_2)

# group: Merge Lists
list_create = List.Create(item0=all_elements_of_category, item1=all_elements_of_category_2)

# group: List flatener (?)
number_slider = DoubleSlider(5, range=1..10 step 1)
flatten = List.Flatten(list=list_create, amt=number_slider)

# group: Get elements list location
getLocation = Element.GetLocation(element=flatten)
