# Dynamo graph ex 6-  to practice getting type parameters -filter by bool mask and common programming logic.dyn "ex 6- to practice getting type parameters -filter by bool mask and common programming logic" (Dynamo 2.6.1.8786)

# group: Create List of Walls
categories = Categories("OST_Walls")
all_elements_of_category = ElementsOfCategory(Category=categories)

elementType = Element.ElementType(element=all_elements_of_category)
name = Element.Name(element=elementType)
string = StringInput("Curtain")
contains = String.Contains(str=name, searchFor=string)

# group: Filter list for Curtain Walls
filterByBoolMask = List.FilterByBoolMask(list=all_elements_of_category, mask=contains)
list_create = List.Create(item0=filterByBoolMask.in)

# group: Filter list for Curtain Walls
filterByBoolMask_2 = List.FilterByBoolMask()  # unwired: list, mask
list_create_2 = List.Create(item0=filterByBoolMask_2.in)

wall_types = WallTypes("Wall-Ext_102Bwk-75Ins-100LBlk-12P")
select_model_element = DSModelElementSelection()  # 1 picked in the model
name_2 = Element.Name(element=select_model_element)
code_block = CodeBlock { "Wall-Ext_102Bwk-75Ins-100LBlk-12P"; }
eq = name_2 == code_block
