# Dynamo graph ex 7-  to practice list checking and programming logic, getting_setting parameter values by name.dyn "ex 7- to practice list checking and programming logic, getting_setting parameter values by name" (Dynamo 2.6.1.8786)

# group: Create List of Walls
categories = Categories("OST_Rooms")
all_elements_of_category = ElementsOfCategory(Category=categories)

# group: Filter Rooms under number 20
string = StringInput("Number")
getParameterValueByName = Element.GetParameterValueByName(element=all_elements_of_category, parameterName=string)
toNumber = String.ToNumber(str=getParameterValueByName)
number_slider = DoubleSlider(20, range=0..100 step 0.1)
le = toNumber <= number_slider
type = Object.Type()  # unwired: obj

# group: Mask boolean- room numbers <20
filterByBoolMask = List.FilterByBoolMask(list=all_elements_of_category, mask=le)
list_create = List.Create(item0=filterByBoolMask.in)

string_2 = StringInput("Comments")
string_3 = StringInput("Checked")
setParameterByName = Element.SetParameterByName(element=filterByBoolMask.in, parameterName=string_2, value=string_3)
