# Dynamo graph gethostelements.dyn (Dynamo 2.6.1.8786)

categories = Categories("OST_Doors")
all_elements_of_category = ElementsOfCategory(Category=categories)
string = StringInput("Host Id")
getParameterValueByName = Element.GetParameterValueByName(element=all_elements_of_category, parameterName=string)
getMaterials = Element.GetMaterials(element=getParameterValueByName)
name = Material.Name(material=getMaterials)
string_2 = StringInput("Comments")
string_3 = StringInput("Type")
getParameterValueByName_2 = Element.GetParameterValueByName(element=getParameterValueByName, parameterName=string_3)
name_2 = Element.Name(element=getParameterValueByName_2)
setParameterByName = Element.SetParameterByName(element=all_elements_of_category, parameterName=string_2, value=name_2)
getParameterValueByName_3 = Element.GetParameterValueByName(element=setParameterByName, parameterName=string_2)
